# Grasshopper definition sample_app_gh.gh (Grasshopper 1.0.7)

python = GhPythonScript()  # -> out, a
# ---------- python: Python ----------
__author__ = "viktor"
__version__ = "2022.04.01"
import os

import rhinoscriptsyntax as rs
a = os. getcwd() + '/input.txt'
# ---------- end python ----------
file = ReadFile(File=python.a, PerLineParse=True)

# ---- group: INPUT PARAMETERS (should be read from text file)
pitch_width_m = Slider(70, range=60..70)
offset_from_pitch_m = Slider(4, range=1..10)
asymetry_along_width = Slider(20, range=-20..20)
height_m = Slider(40, range=20..40)
shape_m = Slider(16, range=0..30)
asymetry_along_length = Slider(20, range=-20..20)
depth_factor = Slider(1.5, range=1.2..1.5)

# ----
split = TextSplit(Text=file, Separators=",")
item = ListItem(List=split, Index="1", Wrap=True)
item_2 = ListItem(List=split, Index="0", Wrap=True)
item_3 = ListItem(List=split, Index="2", Wrap=True)
item_4 = ListItem(List=split, Index="3", Wrap=True)
item_5 = ListItem(List=split, Index="4", Wrap=True)
item_6 = ListItem(List=split, Index="5", Wrap=True)
item_7 = ListItem(List=split, Index="6", Wrap=True)

# ---- group: pitch
division = Division(A=Slider(105, range=0..1000), B=2)
division_2 = Division(A=item_2, B=2)
dom = ConstructDomain(DomainStart=expr("-x", division), DomainEnd=division)
dom_2 = ConstructDomain(DomainStart=expr("-x", division_2), DomainEnd=division_2)
dedomain = DeconstructDomain(Domain=dom_2)  # -> Start, End
pt = ConstructPoint(XCoordinate=0, YCoordinate=dedomain.End, ZCoordinate=0)
pt_2 = ConstructPoint(XCoordinate=0, YCoordinate=dedomain.Start, ZCoordinate=0)
ln = Line(StartPoint=pt_2, EndPoint=pt)
cir = Circle(Plane=PlaneXY(0, 0, 0), Radius=Slider(8, range=0..10))
rectangle = Rectangle(Plane=PlaneXY(0, 0, 0), XSize=dom, YSize=dom_2, Radius=0)  # -> Rectangle, Length

# ---- group: inner curve
offset = OffsetCurve(Curve=rectangle.Rectangle, Distance=item_3, Corners=1)
disc = Discontinuity(Curve=rectangle.Rectangle, Level=1)  # -> Points, Parameters
explode = Explode(Curve=offset, Recursive=True)  # -> Segments, Vertices
midpt = CurveMiddle(Curve=explode.Segments)
weave = Weave(Pattern=[0, 1], Stream0=disc.Points, Stream1=midpt, NullGaps=False)
intcrv = Interpolate(Vertices=weave, Degree=3, Periodic=True, KnotStyle=1)  # -> Curve, Length, Domain

# ---- group: outer curve
offset_2 = OffsetCurve(Curve=intcrv.Curve, Distance=item, Corners=1)

# ---- group: top curves
xy = XYPlane(Origin=Point(0, 0, 0))
vec = VectorXYZ(XComponent=item_5, YComponent=item_6, ZComponent=0)  # -> Vector, Length
division_3 = Division(A=item_7, B=2)
move = Move(Geometry=xy, Motion=vec.Vector)  # -> Geometry, Transform
Z = UnitZ(Factor=division_3)
scale_nu = ScaleNU(Geometry=offset_2, Plane=move.Geometry, ScaleX=item_4, ScaleY=item_4, ScaleZ=1)  # -> Geometry, Transform
move_2 = Move(Geometry=scale_nu.Geometry, Motion=Z)  # -> Geometry, Transform
move_3 = Move(Geometry=offset_2, Motion=expr("x*2", Z))  # -> Geometry, Transform

# ---- group: create surface mesh
custom_mesh_settings = SettingsCustom(
    StitchSeams=True,
    SimplePlanes=False,
    Refine=False,
    MinCount=16,
    MaxCount=400,
    AspectRatio=20,
    MaxDistance=0,
    MaxAngle=20,
    MinEdge=0,
    MaxEdge=0)
loft = Loft(
    Curves=[move_3.Geometry, move_2.Geometry, offset_2],
    Options={Adjust=False, Closed=False, LoftEnds=0, LoftSimp=0, LoftType=0, Rebuild=10, Refit=0.01})
mesh = MeshBrep(Brep=loft, Settings=custom_mesh_settings)
area = Area(Geometry=mesh)  # -> Area, Centroid

# ---- group: deconstruct mesh
tri = Triangulate(Mesh=mesh)  # -> Mesh, Count
medges = MeshEdges(Mesh=tri.Mesh)  # -> NakedEdges, InteriorEdges, NonManifoldEdges
demesh = DeconstructMesh(Mesh=tri.Mesh)  # -> Vertices, Faces, Colours, Normals
deface = DeconstructFace(Face=demesh.Faces)  # -> CornerA, CornerB, CornerC, CornerD
item_8 = ListItem(List=demesh.Vertices, Index=deface.CornerB, Wrap=True)
item_9 = ListItem(List=demesh.Vertices, Index=deface.CornerA, Wrap=True)
item_10 = ListItem(List=demesh.Vertices, Index=deface.CornerC, Wrap=True)

# ---- group: OUTPUT PARAMETERS
amount_of_seats = Integer(area.Area)
circle = Circle(cir)
point1 = Text(item_9)
rec = Rectangle(rectangle.Rectangle)
line = Line(ln)
point2 = Text(item_8)
point3 = Text(item_10)

# ----
python_2 = GhPythonScript()  # -> out, a
# ---------- python_2: Python ----------
__author__ = "viktor"
__version__ = "2022.04.01"
import os

import rhinoscriptsyntax as rs
a = os. getcwd() + '/output.txt'
# ---------- end python_2 ----------
python_write_text_file = GhPythonScript(
    width=division,
    length=division_2,
    point1=point1,
    point2=point2,
    point3=point3,
    amount_of_seats=amount_of_seats,
    file_path=python_2.a)  # -> out, a; inputs point1: list, point2: list, point3: list
# ---------- python_write_text_file: Python ----------
__author__ = "VIKTOR"
__version__ = "2022.03.28"

import rhinoscriptsyntax as rs

with open(file_path, 'w') as textfile:
    textfile.write('{}\n'.format(amount_of_seats))
    textfile.write('{}\n'.format(width))
    textfile.write('{}\n'.format(length))
    for i in range(len(point1)):
        textfile.write(point1[i] + "," + point2[i] + "," + point3[i] + "\n")
# ---------- end python_write_text_file ----------
